vi "Main Window.gvi"   [LabVIEW NXG 5.0.0]
panel controls:
  "Main Tab": i32
  "Light Calibration Tab": i32
  "Start Wavelength (nm)": f64 = 300
  "End Wavelength (nm)": f64 = 900
  "Wavelength Step (nm)": f64 = 5
  "New Spectrum Calibration": bool
  "Load Spectrum Calibration": bool
  "Save Spectrum Calibration": bool
  "Initialize App Bundle Cluster": "Initialize App Bundle Cluster.gtype"
  "Configuration Tab": i32
  "Abort Button": bool
  "Exit App Button": bool
  "Debugging Cluster": "Debugging Cluster.gtype"
  "Rainbow Measurement tab": i32
  "Instrument Coms Info": "Instrument Coms Info.gtype"
  "Rainbow Sweep Param Selector": "Rainbow Sweep Param Selector.gtype" = {0, 1100, 300, 1, 1, 0}
  "Check Dividing Wavelength Calibration": bool
  "New Dividing Wavelength Calibration": bool
  "Load Dividing Wavelength Calibration": bool
  "Measuring Spot Sperctrum Calibration Parameters": "MSpot Spectrum Calibration Parameters.gtype" = {"Min Position (mm)"=0, "Max Position (mm)"=10, "Position step size (mm)"=0.1, "Manual Spectra?"=FALSE}
  "New Light Power Calibration": bool
  "Load Light PowerCalibration": bool
  "Save Light Power Calibration": bool
  "Rainbow Sweep Parameters": "Rainbow Sweep Param Selector.gtype" = {0, 1100, 300, 1, 1, 0}
  "Default Data Saving Location": path
panel indicators:
  "Irradiance Calibration": f64[]
  "Light Power (W)": f64
  "Current Wavelength (nm)": f64
  "Current State": "Queue Instructions Control.gtype"
  "Current Sub State": string
  "Beam Power Density": f64[][]
  "Path Where the Calibration Files Will Be Stored (Can't Be Changed)": path
  "Desired MSpot Calibration Operation": "Calibration Operation Control.gtype"
  "Irradiance Calibration_2": f64[]
  "Sweep Live Parameters": "Sweep Live Parameters.gtype"
types:
  "All Paths Cluster.gtype" = cluster{"Thorlabs Motor Serial Number File Path": path}
  "Instrument Coms Info.gtype" = cluster{"Arduino Coms Info": "Arduino Detection cluster control.gtype", "Photodetector Names": string[], "Keythley Address": "VISA Instr", "Photodetector Detected?": bool, "Thorlabs Motors Detected?": bool, "Keithley Detected?": bool, "Thorlabs Motors Serial Number": "Thorlabs Motors Serial Number In.gtype", "Photodetector IVI session": "Ivi IviDefault"}
  "Initialize App Bundle Cluster.gtype" = cluster{"All Paths": "All Paths Cluster.gtype", "Instrument Coms Info": "Instrument Coms Info.gtype"}
  "Queue Instructions Control.gtype" = enum{"Undefined State", "Debug Check", "Initialize App", "Idle", "Light Power Calibration", "Light Calibration Irradiance", "Light Calibration Spectral Density", "Light Calibration Power Density", "MSpot Spectrum Calibration", "Access TXT File", "Stop App"}
  "Insturment Debugging Cluster.gtype" = cluster{"Keithley": bool, "Arduinos": bool, "Thorlabs Motors": bool, "Photodetector": bool}
  "Debugging Cluster.gtype" = cluster{"Debugging mode?": bool, "Initialize App": bool, "Insturment Debugging": "Insturment Debugging Cluster.gtype"}
  "Raibow Sweep Selector.gtype" = enum{"Red Sweep", "Blue Sweep", "Full Sweep Red First", "Full Sweep Blue First"}
  "Rainbow Sweep Type Selector.gtype" = cluster{"Red Sweep Mode": enum{"Red Sweep Closing", "Red Sweep Opening"}, "Blue Sweep Mode": enum{"Blue Sweep Opening", "Blue Sweep Closing"}}
  "Rainbow Sweep Param Selector.gtype" = cluster{"Raibow Sweep Selector": "Raibow Sweep Selector.gtype", "Max Wavelength (nm)": f64, "Min Wavelength (nm)": f64, "Wavelength Step (nm)": f64, "Rainbow Sweep Types": "Rainbow Sweep Type Selector.gtype"}
  "Calibration Operation Control.gtype" = enum{"Check Calibration", "Load Calibration", "New Calibration"}
  "MSpot Spectrum Calibration Parameters.gtype" = cluster{"Min Position (mm)": f64, "Max Position (mm)": f64, "Position step size (mm)": f64, "Manual Spectra?": bool}
  "Rainbow Sweep Types.gtype" = enum{"Red Sweep Closing", "Red Sweep Opening", "Blue Sweep Closing", "Blue Sweep Opening"}
  "Sweep Live Parameters.gtype" = cluster{"Light Power (W) ": f64, "Current Wavelength (nm)": f64, "Rainbow Sweep Types": "Rainbow Sweep Types.gtype"}
uses:
  Rainbow Measurement Setup::Main Functions::Instruction Queue::Current State::FGV Current State.gvi
  Rainbow Measurement Setup::Main Functions::Debugging::Debugging Prompt.gvi
  Rainbow Measurement Setup::Main Functions::Initialize App::Initialize app subroutine.gvi
  Rainbow Measurement Setup::Side Functions::Global Abort::FGV Global Abort.gvi
  Rainbow Measurement Setup::Main Functions::One Time Calibrations::MSpot Spectrum::File Handling::MSpot Folder Check.gvi
  Rainbow Measurement Setup::Main Functions::One Time Calibrations::MSpot Spectrum::MSpot Spectrum Calibration Subroutine.gvi
  NI::G Core::Error::Is Error.gvi
  Rainbow Measurement Setup::Main Functions::Rainbow Measurement::Light Power Calibration::Light Calibration Live Parameters FGV.gvi
  Rainbow Measurement Setup::Side Functions::Timeout Sequence.gvi
  Rainbow Measurement Setup::Side Functions::Exit App Sequence.gvi
  Rainbow Measurement Setup::Side Functions::Global Abort::Global Abort Sequence.gvi
  Rainbow Measurement Setup::Main Functions::Instruction Queue::Check Current State Idle.gvi
  Rainbow Measurement Setup::Main Functions::Instruction Queue::Conditional Enqueue.gvi
  Rainbow Measurement Setup::Main Functions::One Time Calibrations::MSpot Spectrum::MSpot Calibration Operation Translator.gvi
  NI::G Core::Error::Multiplex Errors.gvi
  NI::G Core::Error::Display Error.gvi
diagram:
  call "FGV Current State.gvi"(Current State Instructions="Set Current State and Substate", Current State="Undefined State", Current Substate="Starting Up") -> (Error Out=w1)
  Obtain Queue(create if not found=TRUE, element data type="Queue Instructions Control.gtype" "Undefined State", error in=w1, name="Instruction Queue") -> (error out=w2, queue out=w3)
  Enqueue Element(element="Debug Check", error in=w2, queue=w3) -> (error out=w4, queue out=w5)
  s1 = w5  # shift register
  s2 = w4  # shift register
  while {
    # This is the consumer loop, it takes enqueued instructions and performs the ne required actions
    case (s2) {
      frame Error, Default {
        w6 = s2
        w7 = s1
        w8 = TRUE
      }
      frame No Error {
        Dequeue Element(error in=s2, queue=s1) -> (element=w9, error out=w10, queue out=w11)
        case (w9) {
          frame "Undefined State" {
            w6 = w10
            w7 = w11
            w8 = default
          }
          frame "Debug Check" {
            call "Debugging Prompt.gvi"(Debugging Cluster In=$"Debugging Cluster", Error In=w10) -> (Debugging Cluster Out=w12, Error Out=w13)
            $"Debugging Cluster" <- w12
            Enqueue Element(element="Initialize App", error in=w13, queue=w11) -> (error out=w6, queue out=w7)
            w8 = default
          }
          frame "Initialize App" {
            call "Initialize app subroutine.gvi"(Initialize App Bundle Cluster In=$"Initialize App Bundle Cluster", Error In=w10, Debugging Cluster=$"Debugging Cluster") -> (Initialize App Bundle Cluster Out=w14, Error Out=w15)
            $"Initialize App Bundle Cluster" <- w14
            Enqueue Element(element="Idle", error in=w15, queue=w11) -> (error out=w6, queue out=w7)
            Property Node(instance in=w14) -> ("Instrument Coms Info"=w16)
            $"Instrument Coms Info" <- w16
            w8 = default
          }
          frame "Idle", Default {
            call "FGV Global Abort.gvi"(Global Abort Instructions="Reset State", Error In=w10) -> (Error Out=w17)
            call "FGV Current State.gvi"(Current State Instructions="Set Current State and Substate", Current State="Idle", Current Substate="Idle", Error In=w17) -> (Error Out=w6)
            w7 = w11
            w8 = default
          }
          frame "Stop App" {
            call "FGV Current State.gvi"(Current State Instructions="Set Current State and Substate", Current State="Stop App", Current Substate="Bye Bye :D", Error In=w10) -> (Error Out=w6)
            w7 = w11
            w8 = TRUE
          }
          frame "MSpot Spectrum Calibration" {
            call "MSpot Folder Check.gvi"(Error In=w10) -> (Error Out=w18, Calibration Files Folder=w19)
            $"Path Where the Calibration Files Will Be Stored (Can't Be Changed)" <- w19
            call "MSpot Spectrum Calibration Subroutine.gvi"(Instrument Coms Info In=$"Instrument Coms Info", Rainbow Sweep Param Selector=$"Rainbow Sweep Param Selector", MSpot Spectrum Calibration Parameters=$"Measuring Spot Sperctrum Calibration Parameters", Debugging Cluster In=$"Debugging Cluster", Error In=w18, Stand Alone?=FALSE, Calibration Operation Control=$"Desired MSpot Calibration Operation") -> (Instrument Coms Info Out=w20, Debugging Cluster Out=w21, Error Out=w22)
            $"Instrument Coms Info" <- w20
            $"Debugging Cluster" <- w21
            Enqueue Element(element="Idle", error in=w22, queue=w11) -> (error out=w6, queue out=w7)
            w8 = default
          }
        }
      }
    }
    call "Is Error.gvi"(error in=w6) -> (error?=w23)
    Logical Or(w23, w8) -> w24
    next s1 = w7
    next s2 = w6
    stop if w24
  }
  # This is the main window it takes instructions from the main pannel introduced by the user and
  # performs the corresponding necessary actions
  s3 = w5  # shift register
  s4 = w4  # shift register
  while {
    # This is the producer loop that takes the commands and if possible enqueues them so that the
    # slave loop can perform the corresponding actions
    event (timeout = 100) {
      on "Timeout" {
        call "Light Calibration Live Parameters FGV.gvi"(FGV Instructions="Read State", Error In=s4) -> (Light Calibration Parameters Out=w28, Error Out=w29)
        call "Timeout Sequence.gvi"(Error In=w29) -> (Current State Out=w30, Current SubState Out=w31, Stop App?=w27, Error Out=w26)
        $"Current State" <- w30
        $"Current Sub State" <- w31
        $"Sweep Live Parameters" <- w28
        w25 = s3
      }
      on "Exit App Button" Value changed {
        call "Exit App Sequence.gvi"(Queue In=s3, Exit App=$"Exit App Button", Error In=s4) -> (Queue Out=w25, Error Out=w26)
        w27 = default
      }
      on "Abort Button" Value changed {
        call "Global Abort Sequence.gvi"(Queue In=s3, Global Abort=$"Abort Button", Error In=s4) -> (Queue Out=w25, Error Out=w26)
        w27 = default
      }
      on "Check Dividing Wavelength Calibration" Value changed; "Load Dividing Wavelength Calibration" Value changed; "New Dividing Wavelength Calibration" Value changed {
        call "Check Current State Idle.gvi"(Error In=s4) -> (Proceed to enqueue=w32, Error Out=w33)
        call "Conditional Enqueue.gvi"(Queue In=s3, Queue Instruction In="MSpot Spectrum Calibration", Error Out=w33, Equeue?=w32) -> (Queue Out=w25, Error In=w34)
        call "MSpot Calibration Operation Translator.gvi"(Check Dividing Wavelength Calibration=$"Check Dividing Wavelength Calibration", New Dividing Wavelength Calibration=$"New Dividing Wavelength Calibration", Load Dividing Wavelength Calibration=$"Load Dividing Wavelength Calibration", Error In=w34) -> (Desired Operation=w35, Error Out=w26)
        $"Desired MSpot Calibration Operation" <- w35
        w27 = default
      }
    }
    next s3 = w25
    next s4 = w26
    stop if w27
  }
  Flush Queue(error in=s4, queue=s3) -> (error out=w36, queue out=w37)
  Release Queue(error in=w36, queue=w37) -> (error out=w38)
  call "Multiplex Errors.gvi"(error in 1=s2, error in 2=w38) -> (error out=w39)
  case (w39) {
    frame Error, Default {
      # In case there is an error
      # put out an error handler
      call "Display Error.gvi"(error in=w39)
    }
    frame No Error { }
  }
